# Grasshopper definition Code of simulation.gh (Grasshopper 1.0.7)
# plug-ins: Colibri

# ----
# Pepole
panel = Panel("0")
occupancy = Panel("""0
0
0
0
0
0
0
0
0
1
1
1
0.5
1
1
1
1
1
0.5
0
0
0
0
0""")
weeklyschedule = HBWeeklySchedule(
    sun=panel,
    mon=occupancy,
    tue=occupancy,
    wed=occupancy,
    thu=occupancy,
    fri=occupancy,
    sat=panel,
    holiday=panel,
    summer_des=panel,
    winter_des=panel,
    name="Occupancy_Schedule_test",
    type_limit="Fractional")  # -> report, schedule, idf_year, idf_week, idf_days; plug-in component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
constantschedule = HBConstantSchedule(values="120", name="Activity Schedule", type_limit="Activity Level")  # -> report, schedule, idf_text; plug-in component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
division = Division(A="4", B="48")
people = HBPeople(
    name="BESTEST_People",
    ppl_per_area=division,
    occupancy_sch=weeklyschedule.schedule,
    activity_sch=constantschedule.schedule)  # -> people; plug-in component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

# ----
# Infiltration
panel_2 = Panel("Infiltration_Schedule")
constantschedule_2 = HBConstantSchedule(values="1", name=panel_2, type_limit="Fractional")  # -> report, schedule, idf_text; plug-in component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
infiltration = HBInfiltration(name="BESTEST_Infiltration", flow_per_ext_area="0.0005", schedule=constantschedule_2.schedule)  # -> infil; plug-in component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

cluster = Cluster_4()
cluster_2 = Cluster_5()
programtype = HBProgramType(name="best_test_program", people=people, lighting=cluster, electric_equip=cluster_2, infiltration=infiltration)  # -> program; plug-in component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

# ----
# فاصله دو پوسته
distance_from_facade = Slider(0.04, range=0..0.04, expression="x*10")

zone = Brep(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)

# ----
# زاویه پترن
angle_of_pattern = Slider(8, range=1..8)

# ----
# فرد : برای متقارن بودن سمت راست و چپ شکل
extent_x = Slider(25, range=9..25)
extent_y = Slider(2, range=2..6)

roomsolid = HBRoomFromSolid(geo=flatten(zone), program=programtype, conditioned=True)  # -> out, rooms; plug-in component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
decnstrobj = HBDeconstructObject(hb_obj=roomsolid.rooms)  # -> faces, apertures, doors, shades; plug-in component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
pattern = Pattern(ex=extent_x, ey=extent_y, B=distance_from_facade, A=angle_of_pattern)
explode_tree = ExplodeTree(Data=graft(decnstrobj.faces))  # -> _0000, _0001, _0002, _0003, _0004, _0005

# ----
# پوسته دوم
brep = Brep(pattern)

data = Data([explode_tree._0001, explode_tree._0003, explode_tree._0004, explode_tree._0005, explode_tree._0000])
boolean_toggle = BooleanToggle(True)
X = UnitX(Factor="-57.3")
adiabaticbytype = HBAdiabaticByType(
    hb_objs=flatten(data),
    exterior_walls=boolean_toggle,
    roofs=boolean_toggle,
    exposed_floors=boolean_toggle,
    interior_walls=boolean_toggle,
    interior_floors=boolean_toggle)  # -> hb_objs; plug-in component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
move = Move(Geometry=brep, Motion=X)  # -> Geometry, Transform
Z = UnitZ(Factor="-7.8")
move_2 = Move(Geometry=move.Geometry, Motion=Z)  # -> Geometry, Transform
room = HBRoom(faces=flatten([explode_tree._0002, adiabaticbytype]), conditioned=True)  # -> out, room; plug-in component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
window = Brep([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])
aperture = HBAperture(geo=window)  # -> out, apertures; plug-in component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
addsubface = HBAddSubface(hb_obj=flatten(room.room), sub_faces=flatten(aperture.apertures))  # -> hb_obj; plug-in component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
wires = BrepWireframe(Brep=[zone, move_2.Geometry], Density=-1)

# ----
# Lightweight-Case:Floor
cluster_3 = Cluster_2()

# ----
# Lightweight Case: Wall
cluster_4 = Cluster()

# ----
# Lightweight Case: Roof
# window
cluster_5 = Cluster_3()

ext = ExtendCurve(Curve=[wires, window], Type=0, Start=".2", End=".2")
applysetpointvals = HBApplySetpointValues(room_or_program=flatten(addsubface), cooling_setpt=Slider(27, range=0..100), heating_setpt=Slider(20, range=0..100))  # -> out, mod_obj; plug-in component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

subfacesubset = HBSubfaceSubset()  # -> subface_set; plug-in component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
exteriorsubset = HBExteriorConstructionSubset(exterior_wall=cluster_4, exterior_roof=cluster_3, exposed_floor=cluster_5)  # -> exterior_set; plug-in component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
groundsubset = HBGroundConstructionSubset(ground_roof=cluster_3)  # -> ground_set; plug-in component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
constructionset = HBConstructionSet(name="CustomSet", exterior_subset=exteriorsubset, ground_subset=groundsubset, subface_subset=subfacesubset)  # -> constr_set; plug-in component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

preview = CustomPreview(Geometry=ext, Material=ColourSwatch(SwatchColor=RGB(0, 0, 0)))
idealair = HBIdealAir(rooms=flatten(applysetpointvals.mod_obj))  # -> out, rooms; plug-in component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
applyconstrset = HBApplyConstructionSet(rooms=idealair.rooms, constr_set=constructionset)  # -> rooms; plug-in component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
shade = HBShade(geo=move_2.Geometry)  # -> report, shades; plug-in component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
toggle = BooleanToggle(True)
simoutput = HBSimulationOutput(zone_energy_use=toggle, comfort_metrics=toggle)  # -> report, sim_output; plug-in component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
addshade = HBAddShade(hb_obj=applyconstrset, out_shades=flatten(shade.shades))  # -> hb_obj; plug-in component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
simpar = HBSimulationParameter(output=simoutput.sim_output, timestep=6)  # -> sim_par; plug-in component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
gridrooms = HBSensorGridFromRooms(rooms=addshade, grid_size="0.5")  # -> grid, points, mesh; plug-in component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
model = HBModel(rooms=flatten(addshade))  # -> report, model; plug-in component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
toggle_2 = BooleanToggle(False)
file_path = FilePath("C:\Users\mheiranipour\Desktop\sara\ESP_CT_Barcelona-El.Prat.AP.081810_TMYx.2007-2021\ESP_CT_Barcelona-El.Prat.AP.081810_TMYx.2007-2021.epw")
modeltoosm = HBModelToOSM(model=model.model, epw_file=file_path, sim_par=simpar, write=toggle_2, run=toggle_2)  # -> report, jsons, osw, osm, idf, sql, zsz, rdd, html; plug-in component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
assigngridsviews = HBAssignGridsAndViews(model=model.model, grids=flatten(gridrooms.grid))  # -> model; plug-in component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
wea = HBWeaFromEPW(epw_file=file_path)  # -> wea; plug-in component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
debrep = DeconstructBrep(Brep=zone)  # -> Faces, Edges, Vertices
vizbytype = HBVisualizeByType(hb_objs=model.model)  # -> walls, interior_walls, roofs, ceilings, exterior_floors, interior_floors, air_walls, apertures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; plug-in component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
eui = HBEndUseIntensity(sql=modeltoosm.sql)  # -> eui, eui_end_use, end_uses, gross_floor; plug-in component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
item = ListItem(List=debrep.Faces, Index="5", Wrap=True)
eui_kwh_m2 = Panel(eui.eui)
bang = ExplodeTree(Data=graft(eui.eui_end_use))  # -> Branch0, Branch1, Branch2, Branch3
panel_3 = Panel(eui.eui_end_use)
flip = Flip(Surface=item)  # -> Surface, Result
data_2 = Data([vizbytype.walls, vizbytype.interior_walls, vizbytype.ceilings, vizbytype.interior_floors, vizbytype.outdoor_shades])
panel_4 = Panel(eui.end_uses)
annualdaylight = HBAnnualDaylight(model=assigngridsviews, wea=wea, enhanced=Toggle(False), run=Toggle(True))  # -> report, results, DA, cDA, UDI, UDI_low, UDI_up; plug-in component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
sda = HBSpatialDaylightAutonomy(DA=annualdaylight.DA)  # -> report, sDA, pass_fail; plug-in component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
vizall = HBVisualizeAll(hb_objs=flatten(model.model))  # -> geo; plug-in component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
viewpercent = LBViewPercent(
    view_type="1",
    geometry=flatten(flip.Surface),
    context=flatten(data_2),
    grid_size=".2",
    offset_dist="1.2",
    geo_block=Toggle(True),
    run=Toggle(True))  # -> report, points, view_vecs, results, mesh, legend, title, int_mtx; plug-in component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
avr = Average(Input=viewpercent.results)
mjoin = MeshJoin(Meshes=gridrooms.mesh)
annualglare = HBImagelessAnnualGlare(model=assigngridsviews, wea=wea, run=Toggle(True))  # -> report, results, GA; plug-in component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
data_3 = Data(flatten(annualdaylight.DA))
roomcomfortresult = HBReadRoomComfortResult(sql=modeltoosm.sql)  # -> oper_temp, air_temp, rad_temp, rel_humidity; plug-in component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
heatmap = LBSpatialHeatmap(values=data_3, mesh=mjoin, legend_title="%")  # -> mesh, legend, title, colors, legend_par, vis_set; plug-in component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
pmv = LBPMVComfort(
    air_temp=roomcomfortresult.air_temp,
    mrt=roomcomfortresult.rad_temp,
    rel_humid=roomcomfortresult.rel_humidity,
    met_rate=Slider(1.2, range=1..1.3),
    run=Toggle(False))  # -> report, pmv, ppd, set, comfort, condition, heat_loss, comf_obj; plug-in component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
glaremetrics = HBAnnualGlareMetrics(results=annualglare.results, occ_sch=weeklyschedule.schedule)  # -> report, GA, sGA, pass_fail; plug-in component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
analysisperiod = LBAnalysisPeriod(start_month=1, start_day=1, start_hour="8", end_hour="19")  # -> period, hoys, dates; plug-in component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
applyper = LBApplyAnalysisPeriod(data=pmv.pmv, period=analysisperiod.period)  # -> data; plug-in component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
xdata = LBDeconstructData(data=applyper)  # -> header, values; plug-in component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
smaller = SmallerThan(FirstNumber=xdata.values, SecondNumber="1")  # -> SmallerThan, OrEqualTo
larger = LargerThan(FirstNumber=xdata.values, SecondNumber="-1")  # -> LargerThan, OrEqualTo
and = GateAnd(A=smaller.OrEqualTo, B=larger.OrEqualTo)
dispatch = Dispatch(List=xdata.values, DispatchPattern=and)  # -> ListA, ListB
lng = ListLength(List=dispatch.ListA)
number_of_hours_in_comfort_range = Number(flatten(lng))
view_to_outdoor = Data(flatten(avr))
cooling = Number(flatten(bang.Branch1))
eui_2 = Number(flatten(eui.eui))
heating = Number(flatten(bang.Branch0))
sga = Data(flatten(glaremetrics.sGA))
parameters = ColibriParameters(
    EUI=flatten(eui_2),
    Heating=flatten(heating),
    cooling=flatten(cooling),
    sGA=flatten(sga),
    number_of_hours_in_comfort_range=flatten(number_of_hours_in_comfort_range),
    View_to_outdoor=flatten(view_to_outdoor))
iterator = ColibriIterator(
    Extent_X=extent_x,
    Extent_Y=extent_y,
    Distance_from_facade=distance_from_facade,
    Angle_of_pattern=angle_of_pattern,
    RemoteFly=False,
    ignoreAllWarningMsg=False)  # -> Extent_X, Extent_Y, Distance_from_facade, Angle_of_pattern, Genome
img_setting = ImageSetting(ImageSaveAsName="defaultName", Width=600, Height=600)
aggregator = ColibriAggregator(
    Folder="c:\Colibri",
    IterationGenomeID=iterator.Genome,
    IterationPhenomeResults=parameters,
    Write=Toggle(False),
    recordingMode=3)

# ==== cluster Pattern
ex = ClusterInput()
ey = ClusterInput()
xz = XZPlane(Origin=Point(0, 0, 0))
trigrid = Triangular(Plane=xz, Size=1, ExtentX=ex, ExtentY=ey)  # -> flatten(Cells), Points

# ---- group: قرار دادن مثلث ها در دو دسته : مثلث های رو به بالا و رو به پایین
offset_l = OffsetCurveLoose(Curve=trigrid.Cells, Distance=expr("-x", "0.04"))
explode = Explode(Curve=offset_l, Recursive=True)  # -> Segments, Vertices
xz_2 = XZPlane(Origin=Point(0, 0, 0))
item = ListItem(List=explode.Segments, Index=0, Wrap=True)
angle = Angle(VectorA=item, VectorB=Vector(0, 0, 1), Plane=xz_2)  # -> Angle, Reflex
smaller = SmallerThan(FirstNumber=angle.Angle, SecondNumber="0.5*pi")  # -> flatten(SmallerThan), OrEqualTo
cull = CullPattern(List=offset_l, CullPattern=invert(smaller.SmallerThan))
cull_2 = CullPattern(List=offset_l, CullPattern=smaller.SmallerThan)

# ---- group: به دست آوردن مرز بیرونی مثلث ها در یک مستطیل
bbox = BoundingBox(Content=trigrid.Cells, Plane=PlaneXY(0, 0, 0), UnionBox=True)  # -> Box, Box_2

# ---- group: تعیین محل قرار گیری مدول روی مثلث ها
area = Area(Geometry=cull_2)  # -> Area, Centroid
area_2 = Area(Geometry=cull)  # -> Area, Centroid
X = UnitX(Factor=1)
Z = UnitZ(Factor=1)
pl = ConstructPlane(Origin=area.Centroid, XAxis=expr("-x", X), YAxis=expr("-x", Z))
xz_3 = XZPlane(Origin=area_2.Centroid)
weave = Weave(Pattern=[0, 1], Stream0=xz_3, Stream1=pl, NullGaps=False)

# ----
A = ClusterInput()
مستطیلی_که_قرار_است_پنل_ها_روی_آن_قرار_ب = Curve(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)  # "مستطیلی که قرار است پنل ها روی آن قرار بگیرند"
فاصله_اسکلت_مثلثی_تا_دیوار_اصلی = Panel("-0.2")
Y = UnitY(Factor=فاصله_اسکلت_مثلثی_تا_دیوار_اصلی)
move = Move(Geometry=مستطیلی_که_قرار_است_پنل_ها_روی_آن_قرار_ب, Motion=Y)  # -> Geometry, Transform
B = ClusterInput()

# ---- group: پنل واحد
# چرخش لاین
# توی ورودی زاویه
# x*10
# جایگذاری شده است که از 10 درجه تا 80 درجه را در بر بگبرد
item_2 = ListItem(List=offset_l, Index=0, Wrap=True)
X_2 = UnitX(Factor=1)

# مرکز لاین پایینی
explode_2 = Explode(Curve=item_2, Recursive=True)  # -> Segments, Vertices
item_3 = ListItem(List=explode_2.Segments, Index="0", Wrap=True)
midpt = CurveMiddle(Curve=item_3)

# مرکز
area_3 = Area(Geometry=item_2)  # -> Area, Centroid

# نقطه سمت راست
disc = Discontinuity(Curve=item_2, Level=1)  # -> Points, Parameters
item_4 = ListItem(List=disc.Points, Index="1", Wrap=True)

# دایره
Y_2 = UnitY(Factor=1)
ln = Line(StartPoint=area_3.Centroid, EndPoint=flatten(item_4))
pl_2 = ConstructPlane(Origin=area_3.Centroid, XAxis=ln, YAxis=Y_2)
cir = Circle(Plane=pl_2, Radius=ln)  # -> flatten(Circle)

ln_2 = Line(StartPoint=area_3.Centroid, EndPoint=midpt)
rot3d = Rotate3D(Geometry=ln_2, Angle=expr("x*10", degrees(A)), Center=area_3.Centroid, Axis=X_2)  # -> Geometry, Transform

# ----
# خط قرمز را
# با کامپوننت
# Extrude point
# به نقطه مشکی رنگ میرسانیم
# تشکیل صفحه اول
end = EndPoints(Curve=rot3d.Geometry)  # -> Start, End
sph = Sphere(Base=end.End, Radius=expr("x/2", item_3))
bcx = BrepCurve(Brep=sph, Curve=cir)  # -> Curves, Points
item_5 = ListItem(List=bcx.Points, Index="0", Wrap=True)
extr = ExtrudePoint(Base=rot3d.Geometry, Point=flatten(item_5))

# ----
# (تشکیل صفحات کامل)
# ابتدا صفحه اولیه را
# Mirror
# میکنیم و سپس آنها را حول مرکز مثلث
# array
# می کنیم
yz = YZPlane(Origin=end.End)
mirror = Mirror(Geometry=extr, Plane=yz)  # -> Geometry, Transform
join = BrepJoin(Breps=[mirror.Geometry, extr])  # -> Breps, Closed
xz_4 = XZPlane(Origin=area_3.Centroid)
arrpolar = PolarArray(Geometry=join.Breps, Plane=xz_4, Count="3", Angle=6.283185307)  # -> Geometry, Transform
join_2 = BrepJoin(Breps=flatten(arrpolar.Geometry))  # -> Breps, Closed

# ---- group: در مرحله بعدی پنل را از این نقطه، به سمت ِمراکز مثلث های اصلی هدایت میکنیم
debrep = DeconstructBrep(Brep=join_2.Breps)  # -> Faces, Edges, Vertices
item_6 = ListItem(List=debrep.Vertices, Index=0, Wrap=True)
xz_5 = XZPlane(Origin=item_6)

# ----
orient = Orient(Geometry=join_2.Breps, Source=xz_5, Target=weave)  # -> Geometry, Transform
entwine = Entwine(Branch00=orient.Geometry, Branch01=trigrid.Cells, FlattenInputs=True)

# ---- group: انتقال پنل ها روی دیوار اصلی
sporph = Sporph(G=entwine, S0=reparameterize(bbox.Box), P0="0.5,0.5", S1=reparameterize(move.Geometry), P1="0.5,0.5", R=False)

# ----
bang = ExplodeTree(Data=sporph)  # -> Branch0, Branch1
item_7 = ListItem(List=bang.Branch0, Index=0, Wrap=True)
bbox_2 = BoundingBox(Content=item_7, Plane=PlaneXY(0, 0, 0))  # -> Box, Box_2

# ---- group: لوله ای کردن اسکلت مثلثی
explode_3 = Explode(Curve=bang.Branch1, Recursive=True)  # -> flatten(Segments), Vertices
midpt_2 = CurveMiddle(Curve=explode_3.Segments)
cullpt = CullDuplicates(Points=midpt_2, Tolerance=0.1, CullMode=1)  # -> Points, Indices, Valence
item_8 = ListItem(List=explode_3.Segments, Index=cullpt.Indices, Wrap=True)

# ---- group: اتصال به دیوار
srf = Surface(bang.Branch1)
join_3 = BrepJoin(Breps=srf)  # -> Breps, Closed
edges = BrepEdges(Brep=join_3.Breps)  # -> Naked, Interior, NonManifold
join_4 = JoinCurves(Curves=edges.Naked, Preserve=False)
explode_4 = Explode(Curve=join_4, Recursive=True)  # -> Segments, Vertices

# ----
wires = BrepWireframe(Brep=bbox_2.Box, Density=-1)
item_9 = ListItem(List=wires, Index="1", Wrap=True)
num = Number(item_9)
addition = Addition(A=num, B=B)
len = Length(Curve=item_8)
Y_3 = UnitY(Factor=addition)

# ---- group: اتصال به دیوار
# شعاع دایره
project = Project(Geometry=explode_4.Vertices, Plane=مستطیلی_که_قرار_است_پنل_ها_روی_آن_قرار_ب)  # -> Geometry, Transform
ln_3 = Line(StartPoint=explode_4.Vertices, EndPoint=project.Geometry)
panel = Panel("""0
0.1
0.2""")
eval = EvaluateLength(Curve=graft(ln_3), Length=panel, Normalized=invert(True))  # -> Point, Tangent, Parameter
pframe = PerpFrame(Curve=graft(ln_3), Parameter=eval.Parameter)
merge = Merge(Data1="0.0001", Data2="0.02", Data3="0.02")
cir_2 = Circle(Plane=pframe, Radius=merge)
loft = Loft(Curves=cir_2, Options={Adjust=False, Closed=False, LoftEnds=0, LoftSimp=0, LoftType=3, Rebuild=10, Refit=0.01})
preview = CustomPreview(Geometry=loft, Material=ColourSwatch(SwatchColor=RGB(0, 255, 255)))

# ----
move_2 = Move(Geometry=bang.Branch0, Motion=expr("-x", Y_3))  # -> Geometry, Transform
پنل_ها = ClusterOutput(move_2.Geometry)

# ---- group: Edges
wires_2 = BrepWireframe(Brep=move_2.Geometry, Density=-1)

# ----
preview_2 = CustomPreview(Geometry=move_2.Geometry, Material=ColourSwatch(SwatchColor=RGBA(255, 0, 0, 76)))
panel_2 = Panel(move_2.Transform)

deconstruct_brep = DeconstructBrep(Brep=move_2.Geometry)  # -> Faces, Edges, Vertices
# اندازه گذاری پنل
line_dimension = LineDimension(Line=deconstruct_brep.Edges, Text="{0:0.00}", Size="0.04")

# ---- group: اتصال پنل به فریم ها
debrep_2 = DeconstructBrep(Brep=move_2.Geometry)  # -> Faces, Edges, Vertices
panel_3 = Panel("""1
3
5""")
crv = Curve(bang.Branch1)
item_10 = ListItem(List=debrep_2.Vertices, Index=panel_3, Wrap=True)  # -> flatten(Item)
disc_2 = Discontinuity(Curve=crv, Level=1)  # -> flatten(Points), Parameters
cullpt_2 = CullDuplicates(Points=disc_2.Points, Tolerance=0.1, CullMode=1)  # -> Points, Indices, Valence
cp = ClosestPoint(Point=item_10, Cloud=cullpt_2.Points)  # -> ClosestPoint, CPIndex, Distance
ln_4 = Line(StartPoint=flatten(item_10), EndPoint=cp.ClosestPoint)

# ----
previewlw = CustomPreviewLineweights(Geometry=ln_4, Shader=ColourSwatch(SwatchColor=RGB(255, 0, 0)), Thickness="10", Absolute=False)

# ---- group: لوله ای کردن اسکلت مثلثی
# شعاع دایره
number_slider = Slider(0.09, range=0.05..0.15)
subtraction = Subtraction(A=len, B=number_slider)
panel_4 = Panel("0.02")
merge_2 = Merge(Data1="0.0001", Data2=panel_4, Data3=panel_4, Data4="0.0001")

# ----
long = LongestList(ListA="0", ListB=number_slider, ListC=subtraction, ListD=len, PaddingMode=2)  # -> ListA, ListB, ListC, ListD
merge_3 = Merge(Data1=graft(long.ListA), Data2=graft(long.ListB), Data3=graft(long.ListC), Data4=graft(long.ListD))
pframe_2 = PerpFrame(Curve=graft(item_8), Parameter=merge_3)

# ---- group: لوله ای کردن اسکلت مثلثی (continued)
cir_3 = Circle(Plane=pframe_2, Radius=merge_2)
loft_2 = Loft(Curves=cir_3, Options={Adjust=False, Closed=False, LoftEnds=0, LoftSimp=0, LoftType=3, Rebuild=10, Refit=0.01})
preview_3 = CustomPreview(Geometry=loft_2, Material=ColourSwatch(SwatchColor=RGB(0, 255, 255)))

# ---- group: Node
sph_2 = Sphere(Base=cullpt_2.Points, Radius=expr("x*2", panel_4))
preview_4 = CustomPreview(Geometry=sph_2, Material=ColourSwatch(SwatchColor=RGB(0, 0, 255)))

# ==== cluster Cluster
opaquematnomass = HBOpaqueMaterialNoMass(name="Exterior_surface_coefficient", r_value=Slider(0.034, range=0..0.1))  # -> mat; plug-in component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
opaquemat = HBOpaqueMaterial(
    name="Wood_siding",
    thickness=Slider(0.009, range=0..0.01),
    conductivity=Slider(0.14, range=0..1),
    density=Slider(530, range=0..1000),
    spec_heat=Slider(900, range=0..1000))  # -> mat; plug-in component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
opaquemat_2 = HBOpaqueMaterial(
    name="Fiberglass_quilt",
    thickness=Slider(0.066, range=0..0.1),
    conductivity=Slider(0.04, range=0..0.1),
    density=Slider(12, range=0..100),
    spec_heat=Slider(840, range=0..1000))  # -> mat; plug-in component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
opaquemat_3 = HBOpaqueMaterial(
    name="Plasterboard",
    thickness=Slider(0.012, range=0..0.1),
    conductivity=Slider(0.16, range=0..1),
    density=Slider(950, range=0..1000),
    spec_heat=Slider(840, range=0..1000))  # -> mat; plug-in component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
opaquematnomass_2 = HBOpaqueMaterialNoMass(name="Interior_surface_coefficient", r_value=Slider(0.121, range=0..1))  # -> mat; plug-in component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
merge = Merge(Data1=opaquematnomass, Data2=opaquemat, Data3=opaquemat_2, Data4=opaquemat_3, Data5=opaquematnomass_2)
opaqueconstr = HBOpaqueConstruction(name="Wall", materials=merge)  # -> constr; plug-in component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
constr = ClusterOutput(opaqueconstr)

# ==== cluster Cluster_2
opaquemat = HBOpaqueMaterial(
    name="Insulation",
    thickness=Slider(1.003, range=0..10),
    conductivity=Slider(0.04, range=0..0.1),
    density=Slider(0.001, range=0..0.001),
    spec_heat=Slider(100, range=0..100))  # -> mat; plug-in component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
opaquemat_2 = HBOpaqueMaterial(
    name="Timber_flooring",
    thickness=Slider(0.025, range=0..0.1),
    conductivity=Slider(0.14, range=0..1),
    density=Slider(650, range=0..1000),
    spec_heat=Slider(1200, range=0..10000))  # -> mat; plug-in component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
opaquematnomass = HBOpaqueMaterialNoMass(name="Interior_surface_coefficient", r_value=Slider(0.121, range=0..1))  # -> mat; plug-in component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
merge = Merge(Data1=opaquemat, Data2=opaquemat_2, Data3=opaquematnomass)
opaqueconstr = HBOpaqueConstruction(name="Floor", materials=merge)  # -> constr; plug-in component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
constr = ClusterOutput(opaqueconstr)

# ==== cluster Cluster_3
opaquematnomass = HBOpaqueMaterialNoMass(name="Exterior_surface_coefficient", r_value=Slider(0.034, range=0..0.1))  # -> mat; plug-in component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
opaquemat = HBOpaqueMaterial(
    name="Roofdeck",
    thickness=Slider(0.019, range=0..0.1),
    conductivity=Slider(0.14, range=0..1),
    density=Slider(530, range=0..1000),
    spec_heat=Slider(900, range=0..1000))  # -> mat; plug-in component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
opaquemat_2 = HBOpaqueMaterial(
    name="Fiberglass_quilt",
    thickness=Slider(0.1118, range=0..1),
    conductivity=Slider(0.04, range=0..0.1),
    density=Slider(12, range=0..100),
    spec_heat=Slider(840, range=0..1000))  # -> mat; plug-in component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
opaquemat_3 = HBOpaqueMaterial(
    name="Plasterboard",
    thickness=Slider(0.01, range=0..0.1),
    conductivity=Slider(0.16, range=0..1),
    density=Slider(950, range=0..1000),
    spec_heat=Slider(840, range=0..1000))  # -> mat; plug-in component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
opaquematnomass_2 = HBOpaqueMaterialNoMass(name="Interior_surface_coefficient", r_value=Slider(0.121, range=0..1))  # -> mat; plug-in component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
merge = Merge(Data1=opaquematnomass, Data2=opaquemat, Data3=opaquemat_2, Data4=opaquemat_3, Data5=opaquematnomass_2)
opaqueconstr = HBOpaqueConstruction(name="Roof", materials=merge)  # -> constr; plug-in component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
constr = ClusterOutput(opaqueconstr)

# ==== cluster Cluster_4

# ----
# Lighting
panel = Panel("""0.05
0.05
0.05
0.05
0.05
0.05
0.3
0.3
0.9
0.9
0.9
0.9
0.9
0.9
0.9
0.9
0.9
0.9
0.3
0.3
0.05
0.05
0.05
0.05""")
weeklyschedule = HBWeeklySchedule(
    sun="0.05",
    mon=panel,
    tue=panel,
    wed=panel,
    thu=panel,
    fri=panel,
    sat="0.05",
    holiday="0.05",
    summer_des="0.05",
    winter_des="0.05",
    name="Lighting_Schedule",
    type_limit="Fractional")  # -> report, schedule, idf_year, idf_week, idf_days; plug-in component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
lighting = HBLighting(
    name="BESTEST_Lighting",
    watts_per_area="7",
    schedule=weeklyschedule.schedule,
    radiant_fract="0.42",
    visible_fract="0.18")  # -> lighting; plug-in component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

lighting_2 = ClusterOutput(lighting)

# ==== cluster Cluster_5

# ----
# Equip
panel = Panel("Equipment_Schedule")
panel_2 = Panel("""0
0
0
0
0
0
0
0
1
1
1
1
1
0.5
1
1
1
1
0.5
0
0
0
0
0""")
weeklyschedule = HBWeeklySchedule(
    sun="0",
    mon=panel_2,
    tue=panel_2,
    wed=panel_2,
    thu=panel_2,
    fri=panel_2,
    sat="0",
    holiday="0",
    summer_des="0",
    winter_des="0",
    name=panel,
    type_limit="Fractional")  # -> report, schedule, idf_year, idf_week, idf_days; plug-in component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
division = Division(A="150", B="48")
equipment = HBEquipment(name="BESTEST_ElectricalEquipment", watts_per_area=division, schedule=weeklyschedule.schedule, radiant_fract="0.5")  # -> equip; plug-in component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

equip = ClusterOutput(equipment)
